# Grasshopper definition LatLon.ghx (Grasshopper 1.0.7)
# plug-ins: ElkGHComponents, Caribou, PancakeContract

# ---- group: Simple XML FIle
file_path = FilePath("Z:\Sites\Caribou\Caribou.Tests\Cases\simple.xml")

# ---- group: Parse and Compare Craft features
# Elk doesn't pick-up the falcony example (as it's not a defined craft?) so only compare the matching item
file_path_2 = FilePath(file_path)
read_file = ReadFile(File=file_path_2, PerLineParse=False)
location = Location(FilePathText=file_path_2)  # -> OSMPointData, OSMFile, LongitudeDomain, LatitudeDomain
osm_data = OSMData(OSMPointData=location.OSMPointData, OSMFilePath=file_path_2, Feature="craft", Generate3d=False, IndividualOutputs=False)  # -> Ways, FeatureKey
extract_ways = ExtractWays(OSMContent=read_file, OSMFeatures="craft")  # -> Nodes, Tags, Report, Debug
prune_tree = PruneTree(Tree=osm_data.Ways, Minimum=0, Maximum=Slider(1, range=0..1))
list_item = ListItem(List=extract_ways.Nodes, Index=0, Wrap=True)
panel = Panel(prune_tree)
assert_same_content = AssertSameContent(_0=prune_tree, _1=list_item)  # -> Satisfied, ExtraInfo

# ---- group: Parse and Compare Building features
file_path_3 = FilePath(file_path)
read_file_2 = ReadFile(File=file_path_3, PerLineParse=False)
location_2 = Location(FilePathText=file_path_3)  # -> OSMPointData, OSMFile, LongitudeDomain, LatitudeDomain
extract_ways_2 = ExtractWays(OSMContent=read_file_2, OSMFeatures="building")  # -> Nodes, Tags, Report, Debug
extract_ways_3 = ExtractWays(OSMContent=read_file_2, OSMFeatures="building")  # -> Ways, Tags, Report, Debug
osm_data_2 = OSMData(
    OSMPointData=location_2.OSMPointData,
    OSMFilePath=file_path_3,
    Feature="building",
    Generate3d=False,
    IndividualOutputs=False)  # -> Ways, FeatureKey
prune_tree_2 = PruneTree(Tree=osm_data_2.Ways, Minimum=0, Maximum=2)
explode = Explode(Curve=extract_ways_3.Ways, Recursive=True)  # -> Segments, Vertices
prune_tree_3 = PruneTree(Tree=osm_data_2.Ways, Minimum=2, Maximum=0)
assert_same_content_2 = AssertSameContent(_0=flatten(extract_ways_2.Nodes), _1=flatten(prune_tree_2))  # -> Satisfied, ExtraInfo
assert_same_content_3 = AssertSameContent(_0=flatten(explode.Vertices), _1=flatten(prune_tree_3))  # -> Satisfied, ExtraInfo

# ---- group: Parse and Compare Amenity features
file_path_4 = FilePath(file_path)
read_file_3 = ReadFile(File=file_path_4, PerLineParse=False)
location_3 = Location(FilePathText=file_path_4)  # -> OSMPointData, OSMFile, LongitudeDomain, LatitudeDomain
osm_data_3 = OSMData(
    OSMPointData=location_3.OSMPointData,
    OSMFilePath=file_path_4,
    Feature="amenity",
    Generate3d=False,
    IndividualOutputs=False)  # -> Ways, FeatureKey
openstreetmap = OpenStreetMap(OSMContent=read_file_3, OSMFeatures="amenity")  # -> Nodes, Ways, Debug, D
panel_2 = Panel(osm_data_3.Ways)
panel_3 = Panel(openstreetmap.Nodes)
assert_same_content_4 = AssertSameContent(_0=osm_data_3.Ways, _1=openstreetmap.Nodes)  # -> Satisfied, ExtraInfo
