# Grasshopper definition Melbourne.ghx (Grasshopper 1.0.7)
# plug-ins: ElkGHComponents, Caribou, PancakeContract

# ---- group: Simple XML File
path = FilePath("Z:\Sites\Caribou\Caribou.Tests\Cases\melbourne.xml")

# ---- group: Parse and Compare Craft features
file_path = FilePath(path)
read_file = ReadFile(File=file_path, PerLineParse=False)
location = Location(FilePathText=file_path)  # -> OSMPointData, OSMFile, LongitudeDomain, LatitudeDomain
osm_data = OSMData(OSMPointData=location.OSMPointData, OSMFilePath=file_path, Feature="craft", Generate3d=False, IndividualOutputs=False)  # -> Ways, FeatureKey
openstreetmap = OpenStreetMap(OSMContent=read_file, OSMFeatures="craft")  # -> Nodes, Ways, Debug, D
panel = Panel(osm_data.Ways)
panel_2 = Panel(openstreetmap.Nodes)
assert_same_content = AssertSameContent(_0=osm_data.Ways, _1=openstreetmap.Nodes)  # -> Satisfied, ExtraInfo

# ---- group: Parse and Compare Amenity features of Node type
file_path_2 = FilePath(path)
read_file_2 = ReadFile(File=file_path_2, PerLineParse=False)
location_2 = Location(FilePathText=file_path_2)  # -> OSMPointData, OSMFile, LongitudeDomain, LatitudeDomain
osm_data_2 = OSMData(
    OSMPointData=location_2.OSMPointData,
    OSMFilePath=file_path_2,
    Feature="amenity",
    Generate3d=False,
    IndividualOutputs=False)  # -> Ways, FeatureKey
openstreetmap_2 = OpenStreetMap(OSMContent=read_file_2, OSMFeatures="amenity")  # -> Nodes, Ways, Debug, D
point = Point(flatten(openstreetmap_2.Nodes))
prune_tree = PruneTree(Tree=osm_data_2.Ways, Minimum=0, Maximum="2")  # -> flatten(Tree)
assert_same_content_2 = AssertSameContent(_0=flatten(prune_tree), _1=flatten(point))  # -> Satisfied, ExtraInfo
panel_3 = Panel(prune_tree)

# ----
panel_4 = Panel(point)

# ---- group: Parse and Compare Amenity features of Way type
file_path_3 = FilePath(path)
read_file_3 = ReadFile(File=file_path_3, PerLineParse=False)
location_3 = Location(FilePathText=file_path_3)  # -> OSMPointData, OSMFile, LongitudeDomain, LatitudeDomain
osm_data_3 = OSMData(
    OSMPointData=location_3.OSMPointData,
    OSMFilePath=file_path_3,
    Feature="amenity",
    Generate3d=False,
    IndividualOutputs=False)  # -> Ways, FeatureKey
openstreetmap_3 = OpenStreetMap(OSMContent=read_file_3, OSMFeatures="amenity")  # -> Nodes, Ways, Debug, D
prune_tree_2 = PruneTree(Tree=osm_data_3.Ways, Minimum="2", Maximum=0)  # -> flatten(Tree)

# ----
explode = Explode(Curve=openstreetmap_3.Ways, Recursive=True)  # -> Segments, flatten(Vertices)

# ---- group: Parse and Compare Amenity features of Way type (continued)
assert_same_content_3 = AssertSameContent(_0=prune_tree_2, _1=explode.Vertices)  # -> Satisfied, ExtraInfo

# ---- group: Parse and Compare Building features of way type
file_path_4 = FilePath(path)
read_file_4 = ReadFile(File=file_path_4, PerLineParse=False)
location_4 = Location(FilePathText=file_path_4)  # -> OSMPointData, OSMFile, LongitudeDomain, LatitudeDomain
osm_data_4 = OSMData(
    OSMPointData=location_4.OSMPointData,
    OSMFilePath=file_path_4,
    Feature="building",
    Generate3d=False,
    IndividualOutputs=False)  # -> Ways, FeatureKey
openstreetmap_4 = OpenStreetMap(OSMContent=read_file_4, OSMFeatures="building")  # -> Nodes, Ways, Debug, D
explode_2 = Explode(Curve=openstreetmap_4.Ways, Recursive=True)  # -> Segments, flatten(Vertices)

# ----
prune_tree_3 = PruneTree(Tree=osm_data_4.Ways, Minimum="2", Maximum=0)  # -> flatten(Tree)

# ---- group: Parse and Compare Building features of way type (continued)
assert_same_content_4 = AssertSameContent(_0=prune_tree_3, _1=explode_2.Vertices)  # -> Satisfied, ExtraInfo

# ---- group: Parse and Compare Building features of node type
file_path_5 = FilePath(path)
read_file_5 = ReadFile(File=file_path_5, PerLineParse=False)
location_5 = Location(FilePathText=file_path_5)  # -> OSMPointData, OSMFile, LongitudeDomain, LatitudeDomain
osm_data_5 = OSMData(
    OSMPointData=location_5.OSMPointData,
    OSMFilePath=file_path_5,
    Feature="building",
    Generate3d=False,
    IndividualOutputs=False)  # -> Ways, FeatureKey
openstreetmap_5 = OpenStreetMap(OSMContent=read_file_5, OSMFeatures="building")  # -> Nodes, Ways, Debug, D

# ----
prune_tree_4 = PruneTree(Tree=osm_data_5.Ways, Minimum=0, Maximum="2")  # -> flatten(Tree)

# ---- group: Parse and Compare Building features of node type (continued)
assert_same_content_5 = AssertSameContent(_0=prune_tree_4, _1=flatten(openstreetmap_5.Nodes))  # -> Satisfied, ExtraInfo

# ---- group: Parse and Compare Building features and Retail subfeatures of way type
file_path_6 = FilePath(path)
read_file_6 = ReadFile(File=file_path_6, PerLineParse=False)
location_6 = Location(FilePathText=file_path_6)  # -> OSMPointData, OSMFile, LongitudeDomain, LatitudeDomain
osm_data_6 = OSMData(
    OSMPointData=location_6.OSMPointData,
    OSMFilePath=file_path_6,
    Feature="building",
    Generate3d=False,
    IndividualOutputs=False,
    SelectedTypes="retail")  # -> Ways, FeatureKey
openstreetmap_6 = OpenStreetMap(OSMContent=read_file_6, OSMFeatures="building:retail")  # -> Nodes, Ways, Debug, D
explode_3 = Explode(Curve=openstreetmap_6.Ways, Recursive=True)  # -> Segments, flatten(Vertices)

# ----
osm_data_7 = OSMData(
    OSMPointData=location_6.OSMPointData,
    OSMFilePath=file_path_6,
    Feature="building",
    Generate3d=False,
    IndividualOutputs=True,
    SelectedTypes="retail")  # -> Retail, FeatureKey
prune_tree_5 = PruneTree(Tree=osm_data_6.Ways, Minimum="2", Maximum=0)  # -> flatten(Tree)

# ---- group: Parse and Compare Building features and Retail subfeatures of way type (continued)
assert_same_content_6 = AssertSameContent(_0=prune_tree_5, _1=explode_3.Vertices)  # -> Satisfied, ExtraInfo

# ---- group: Parse and Compare Building features and Retail subfeatures of node type
file_path_7 = FilePath(path)
read_file_7 = ReadFile(File=file_path_7, PerLineParse=False)
location_7 = Location(FilePathText=file_path_7)  # -> OSMPointData, OSMFile, LongitudeDomain, LatitudeDomain
openstreetmap_7 = OpenStreetMap(OSMContent=read_file_7, OSMFeatures="building:retail")  # -> Nodes, Ways, Debug, D

# ----
osm_data_8 = OSMData(
    OSMPointData=location_7.OSMPointData,
    OSMFilePath=file_path_7,
    Feature="building",
    Generate3d=False,
    IndividualOutputs=False)  # -> Ways, FeatureKey
prune_tree_6 = PruneTree(Tree=osm_data_8.Ways, Minimum=0, Maximum="2")
point_2 = Point(openstreetmap_7.Nodes)

# ---- group: Parse and Compare Building features and Retail subfeatures of node type (continued)
assert_same_content_7 = AssertSameContent(_0=flatten(prune_tree_6), _1=flatten(openstreetmap_7.Nodes))  # -> Satisfied, ExtraInfo

# ----
panel_5 = Panel(osm_data_8.FeatureKey)
