# Grasshopper definition Wellington.ghx (Grasshopper 1.0.7)
# plug-ins: ElkGHComponents, Caribou, PancakeContract

# ---- group: Simple XML File
path = FilePath("Z:\Sites\Caribou\Caribou.Tests\Cases\wellington-overpass-export")

# ---- group: Parse and Compare Craft features of Node type
file_path = FilePath(path)
read_file = ReadFile(File=file_path, PerLineParse=False)
location = Location(FilePathText=file_path)  # -> OSMPointData, OSMFile, LongitudeDomain, LatitudeDomain
osm_data = OSMData(OSMPointData=location.OSMPointData, OSMFilePath=file_path, Feature="craft", Generate3d=False, IndividualOutputs=False)  # -> Ways, FeatureKey
openstreetmap = OpenStreetMap(OSMContent=read_file, OSMFeatures="craft")  # -> Nodes, Ways, Debug, D
panel = Panel(openstreetmap.Nodes)
panel_2 = Panel(osm_data.Ways)
assert_same_content = AssertSameContent(_0=flatten(osm_data.Ways), _1=flatten(openstreetmap.Nodes))  # -> Satisfied, ExtraInfo

# ---- group: Parse and Compare Amenity features of Node type
# Caribou picks up extra items; perhaps because it's not filtering for a pre-defined set of craft subtypes? Expected failure pending further investigation
file_path_2 = FilePath(path)
read_file_2 = ReadFile(File=file_path_2, PerLineParse=False)
panel_3 = Panel("""amenity=animal_boarding,
amenity=animal shelter,
amenity=arts_centre,
amenity=atm,
amenity=baby_hatch ,
amenity=bank,
amenity=bar,
amenity=bbq ,
amenity=bench,
amenity=bicycle_parking,""")
location_2 = Location(FilePathText=file_path_2)  # -> OSMPointData, OSMFile, LongitudeDomain, LatitudeDomain
osm_data_2 = OSMData(
    OSMPointData=location_2.OSMPointData,
    OSMFilePath=file_path_2,
    Feature="amenity",
    Generate3d=False,
    IndividualOutputs=False)  # -> Ways, FeatureKey
openstreetmap_2 = OpenStreetMap(OSMContent=read_file_2, OSMFeatures=panel_3)  # -> Nodes, Ways, Debug, D
prune_tree = PruneTree(Tree=osm_data_2.Ways, Minimum=0, Maximum="2")  # -> flatten(Tree)
assert_same_content_2 = AssertSameContent(_0=flatten(prune_tree), _1=flatten(openstreetmap_2.Nodes))  # -> Satisfied, ExtraInfo; disabled

# ----
panel_4 = Panel("2")  # disabled
panel_5 = Panel("2")  # disabled
panel_6 = Panel("2")  # disabled

# ---- group: Parse and Compare Amenity features of Way type
file_path_3 = FilePath(path)
read_file_3 = ReadFile(File=file_path_3, PerLineParse=False)
location_3 = Location(FilePathText=file_path_3)  # -> OSMPointData, OSMFile, LongitudeDomain, LatitudeDomain
extract_ways = ExtractWays(OSMContent=read_file_3, OSMFeatures="amenity")  # -> Ways, Tags, Report, Debug
osm_data_3 = OSMData(
    OSMPointData=location_3.OSMPointData,
    OSMFilePath=file_path_3,
    Feature="amenity",
    Generate3d=False,
    IndividualOutputs=False)  # -> Ways, FeatureKey
prune_tree_2 = PruneTree(Tree=osm_data_3.Ways, Minimum="2", Maximum=0)  # -> flatten(Tree)

# ----
explode = Explode(Curve=extract_ways.Ways, Recursive=True)  # -> Segments, flatten(Vertices)

# ---- group: Parse and Compare Amenity features of Way type (continued)
assert_same_content_3 = AssertSameContent(_0=flatten(prune_tree_2), _1=flatten(explode.Vertices))  # -> Satisfied, ExtraInfo

# ---- group: Parse and Compare Building features of way type
file_path_4 = FilePath(path)  # disabled
read_file_4 = ReadFile(File=file_path_4, PerLineParse=False)  # disabled
panel_7 = Panel("building")  # disabled
location_4 = Location(FilePathText=file_path_4)  # -> OSMPointData, OSMFile, LongitudeDomain, LatitudeDomain; disabled
osm_data_4 = OSMData(
    OSMPointData=location_4.OSMPointData,
    OSMFilePath=file_path_4,
    Feature="building",
    Generate3d=False,
    IndividualOutputs=False)  # -> Ways, FeatureKey; disabled

# ----
extract_ways_2 = ExtractWays(OSMContent=read_file_4, OSMFeatures=panel_7)  # -> Ways, Tags, Report, Debug; disabled
prune_tree_3 = PruneTree(Tree=osm_data_4.Ways, Minimum=panel_4, Maximum=0)  # -> flatten(Tree); disabled

# ---- group: Parse and Compare Building features of way type (continued)
explode_2 = Explode(Curve=extract_ways_2.Ways, Recursive=True)  # -> Segments, flatten(Vertices); disabled
assert_same_content_4 = AssertSameContent(_0=flatten(prune_tree_3), _1=flatten(explode_2.Vertices))  # -> Satisfied, ExtraInfo; disabled

# ---- group: Parse and Compare Building features of node type
# Caribou picks up extra items; perhaps because it's not filtering for a pre-defined set of building subtypes? Expected failure pending further investigation
file_path_5 = FilePath(path)  # disabled
read_file_5 = ReadFile(File=file_path_5, PerLineParse=False)  # disabled
panel_8 = Panel("building")  # disabled
location_5 = Location(FilePathText=file_path_5)  # -> OSMPointData, OSMFile, LongitudeDomain, LatitudeDomain; disabled
extract_ways_3 = ExtractWays(OSMContent=read_file_5, OSMFeatures=panel_8)  # -> Nodes, Tags, Report, Debug; disabled
osm_data_5 = OSMData(
    OSMPointData=location_5.OSMPointData,
    OSMFilePath=file_path_5,
    Feature="building",
    Generate3d=False,
    IndividualOutputs=False)  # -> Ways, FeatureKey; disabled

# ----
prune_tree_4 = PruneTree(Tree=osm_data_5.Ways, Minimum=0, Maximum=panel_5)  # -> flatten(Tree); disabled

# ---- group: Parse and Compare Building features of node type (continued)
assert_same_content_5 = AssertSameContent(_0=flatten(prune_tree_4), _1=flatten(extract_ways_3.Nodes))  # -> Satisfied, ExtraInfo; disabled

# ---- group: Parse and Compare Building features and Retail subfeatures of way type
file_path_6 = FilePath(path)
read_file_6 = ReadFile(File=file_path_6, PerLineParse=False)
location_6 = Location(FilePathText=file_path_6)  # -> OSMPointData, OSMFile, LongitudeDomain, LatitudeDomain
osm_data_6 = OSMData(
    OSMPointData=location_6.OSMPointData,
    OSMFilePath=file_path_6,
    Feature="building",
    Generate3d=False,
    IndividualOutputs=False,
    SelectedTypes="retail")  # -> Ways, FeatureKey
extract_ways_4 = ExtractWays(OSMContent=read_file_6, OSMFeatures="building=retail")  # -> Ways, Tags, Report, Debug
explode_3 = Explode(Curve=extract_ways_4.Ways, Recursive=True)  # -> Segments, flatten(Vertices)

# ----
osm_data_7 = OSMData(
    OSMPointData=location_6.OSMPointData,
    OSMFilePath=file_path_6,
    Feature="building",
    Generate3d=False,
    IndividualOutputs=True,
    SelectedTypes="retail")  # -> Retail, FeatureKey
prune_tree_5 = PruneTree(Tree=osm_data_6.Ways, Minimum="2", Maximum=0)  # -> flatten(Tree)

# ---- group: Parse and Compare Building features and Retail subfeatures of way type (continued)
assert_same_content_6 = AssertSameContent(_0=flatten(prune_tree_5), _1=flatten(explode_3.Vertices))  # -> Satisfied, ExtraInfo

# ---- group: Parse and Compare Building features and Retail subfeatures of node type
# Caribou picks up extra items; perhaps because it's not filtering for a pre-defined set of building subtypes? Expected failure pending further investigation
file_path_7 = FilePath(path)  # disabled
panel_9 = Panel("building=retail")  # disabled
read_file_7 = ReadFile(File=file_path_7, PerLineParse=False)  # disabled
location_7 = Location(FilePathText=file_path_7)  # -> OSMPointData, OSMFile, LongitudeDomain, LatitudeDomain; disabled
openstreetmap_3 = OpenStreetMap(OSMContent=read_file_7, OSMFeatures=panel_9)  # -> Nodes, Ways, Debug, D; disabled

# ----
osm_data_8 = OSMData(
    OSMPointData=location_7.OSMPointData,
    OSMFilePath=file_path_7,
    Feature="building",
    Generate3d=False,
    IndividualOutputs=False)  # -> Ways, FeatureKey; disabled
prune_tree_6 = PruneTree(Tree=osm_data_8.Ways, Minimum=0, Maximum=panel_6)  # disabled

# ---- group: Parse and Compare Building features and Retail subfeatures of node type (continued)
assert_same_content_7 = AssertSameContent(_0=flatten(prune_tree_6), _1=flatten(openstreetmap_3.Nodes))  # -> Satisfied, ExtraInfo; disabled
