# Grasshopper definition LatLon.ghx (Grasshopper 1.0.7)
# plug-ins: ElkGHComponents, Caribou, PancakeContract

# ---- group: Simple XML FIle
file_path = FilePath("Z:\Sites\Caribou\Caribou.Tests\Cases\simple.xml")

# ---- group: Parse and Compare Craft features
file_path_2 = FilePath(file_path)
read_file = ReadFile(File=file_path_2, PerLineParse=False)
location = Location(FilePathText=file_path_2)  # -> OSMPointData, OSMFile, LongitudeDomain, LatitudeDomain
osm_data = OSMData(OSMPointData=location.OSMPointData, OSMFilePath=file_path_2, Feature="craft", Generate3d=False, IndividualOutputs=False)  # -> Ways, FeatureKey
openstreetmap = OpenStreetMap(OSMContent=read_file, OSMFeatures="craft")  # -> Nodes, Ways, Debug, D
panel = Panel(osm_data.Ways)
panel_2 = Panel(openstreetmap.Nodes)
assert_identical = AssertIdentical(_0=osm_data.Ways, _1=openstreetmap.Nodes)  # -> Satisfied, ExtraInfo

# ---- group: Parse and Compare Building features
file_path_3 = FilePath(file_path)
read_file_2 = ReadFile(File=file_path_3, PerLineParse=False)
location_2 = Location(FilePathText=file_path_3)  # -> OSMPointData, OSMFile, LongitudeDomain, LatitudeDomain
osm_data_2 = OSMData(
    OSMPointData=location_2.OSMPointData,
    OSMFilePath=file_path_3,
    Feature="building",
    Generate3d=False,
    IndividualOutputs=False)  # -> Ways, FeatureKey
openstreetmap_2 = OpenStreetMap(OSMContent=read_file_2, OSMFeatures="building")  # -> Nodes, Ways, Debug, D
panel_3 = Panel(osm_data_2.Ways)
panel_4 = Panel(openstreetmap_2.Ways)
explode = Explode(Curve=openstreetmap_2.Ways, Recursive=True)  # -> Segments, Vertices
assert_same_content = AssertSameContent(_0=osm_data_2.Ways, _1=explode.Vertices)  # -> Satisfied, ExtraInfo

# ---- group: Parse and Compare Amenity features
file_path_4 = FilePath(file_path)
read_file_3 = ReadFile(File=file_path_4, PerLineParse=False)
location_3 = Location(FilePathText=file_path_4)  # -> OSMPointData, OSMFile, LongitudeDomain, LatitudeDomain
osm_data_3 = OSMData(
    OSMPointData=location_3.OSMPointData,
    OSMFilePath=file_path_4,
    Feature="amenity",
    Generate3d=False,
    IndividualOutputs=False)  # -> Ways, FeatureKey
openstreetmap_3 = OpenStreetMap(OSMContent=read_file_3, OSMFeatures="amenity")  # -> Nodes, Ways, Debug, D
panel_5 = Panel(osm_data_3.Ways)
panel_6 = Panel(openstreetmap_3.Nodes)
assert_identical_2 = AssertIdentical(_0=osm_data_3.Ways, _1=openstreetmap_3.Nodes)  # -> Satisfied, ExtraInfo
