# Grasshopper definition Melbourne.ghx (Grasshopper 1.0.7)
# plug-ins: ElkGHComponents, Caribou, PancakeContract

# ---- group: Simple XML File
path = FilePath("Z:\Sites\Caribou\Caribou.Tests\Cases\melbourne.xml")

# ---- group: Parse and Compare Craft features
file_path = FilePath(path)
read_file = ReadFile(File=file_path, PerLineParse=False)
location = Location(FilePathText=file_path)  # -> OSMPointData, OSMFile, LongitudeDomain, LatitudeDomain
osm_data = OSMData(OSMPointData=location.OSMPointData, OSMFilePath=file_path, Feature="craft", Generate3d=False, IndividualOutputs=False)  # -> flatten(Ways), FeatureKey
openstreetmap = OpenStreetMap(OSMContent=read_file, OSMFeatures="craft")  # -> Nodes, Ways, Debug
panel = Panel(osm_data.Ways)
panel_2 = Panel(openstreetmap.Nodes)
assert_same_content = AssertSameContent(_0=osm_data.Ways, _1=openstreetmap.Nodes)  # -> Satisfied, ExtraInfo

# ---- group: Parse and Compare Amenity features of Node type
file_path_2 = FilePath(path)
read_file_2 = ReadFile(File=file_path_2, PerLineParse=False)
location_2 = Location(FilePathText=file_path_2)  # -> OSMPointData, OSMFile, LongitudeDomain, LatitudeDomain
osm_data_2 = OSMData(
    OSMPointData=location_2.OSMPointData,
    OSMFilePath=file_path_2,
    Feature="amenity",
    Generate3d=False,
    IndividualOutputs=False)  # -> Ways, FeatureKey
openstreetmap_2 = OpenStreetMap(OSMContent=read_file_2, OSMFeatures="amenity")  # -> Nodes, Ways, Debug
point = Point(flatten(openstreetmap_2.Nodes))
prune_tree = PruneTree(Tree=osm_data_2.Ways, Minimum=0, Maximum="2")  # -> flatten(Tree)
assert_same_content_2 = AssertSameContent(_0=osm_data_2.Ways, _1=point)  # -> Satisfied, ExtraInfo
panel_3 = Panel(prune_tree)

# ---- group: Parse and Compare Building features
file_path_3 = FilePath(path)
read_file_3 = ReadFile(File=file_path_3, PerLineParse=False)
location_3 = Location(FilePathText=file_path_3)  # -> OSMPointData, OSMFile, LongitudeDomain, LatitudeDomain
osm_data_3 = OSMData(
    OSMPointData=location_3.OSMPointData,
    OSMFilePath=file_path_3,
    Feature="building",
    Generate3d=False,
    IndividualOutputs=False)  # -> Ways, FeatureKey
openstreetmap_3 = OpenStreetMap(OSMContent=read_file_3, OSMFeatures="building")  # -> Nodes, Ways, Debug
explode = Explode(Curve=openstreetmap_3.Ways, Recursive=True)  # -> Segments, Vertices
panel_4 = Panel(osm_data_3.Ways)
panel_5 = Panel(openstreetmap_3.Ways)
assert_same_content_3 = AssertSameContent(_0=osm_data_3.Ways, _1=explode.Vertices)  # -> Satisfied, ExtraInfo

# ----
panel_6 = Panel(point)

# ---- group: Parse and Compare Amenity features of Way type
file_path_4 = FilePath(path)
read_file_4 = ReadFile(File=file_path_4, PerLineParse=False)
location_4 = Location(FilePathText=file_path_4)  # -> OSMPointData, OSMFile, LongitudeDomain, LatitudeDomain
osm_data_4 = OSMData(
    OSMPointData=location_4.OSMPointData,
    OSMFilePath=file_path_4,
    Feature="amenity",
    Generate3d=False,
    IndividualOutputs=False)  # -> Ways, FeatureKey
openstreetmap_4 = OpenStreetMap(OSMContent=read_file_4, OSMFeatures="amenity")  # -> Nodes, Ways, Debug
prune_tree_2 = PruneTree(Tree=osm_data_4.Ways, Minimum="2", Maximum=0)  # -> flatten(Tree)

# ----
explode_2 = Explode(Curve=openstreetmap_4.Ways, Recursive=True)  # -> Segments, flatten(Vertices)

# ---- group: Parse and Compare Amenity features of Way type (continued)
assert_same_content_4 = AssertSameContent(_0=prune_tree_2, _1=explode_2.Vertices)  # -> Satisfied, ExtraInfo
