# Grasshopper definition Caribou - Extensions Example.ghx (Grasshopper 1.0.7)
# plug-ins: Caribou, Human

# ---- group: Define custom queries
panel = Panel("building=office")
panel_2 = Panel("building=apartments")
panel_3 = Panel("addr:street=Taranaki Street")
panel_4 = Panel("highway=traffic_signals")
panel_5 = Panel("amenity=cafe")
panel_6 = Panel("cuisine=mexican")
panel_7 = Panel("building=industrial")

# ----
specify_features = SpecifyFeatures(selectionHidesObscure=True, selectionSerialised="craft=*,emergency=*,healthcare=*,highway=*,historic=*,sport=*")  # -> OSMFeatures, Debug

# ---- group: Reference OSM example here
# NOTE!: If you want to see this example file in action, you will need to reference a downloaded Open Street Map xml file into the file path parameter to the right ->
file_path = FilePath("Z:\Sites\Caribou\OSM Test Data\wellington-overpass-export.osm")

# ----
file_path_2 = FilePath(file_path)
file_path_3 = FilePath(file_path)
text = Text(specify_features.OSMFeatures)
extract_nodes = ExtractNodes(OSMFilePath=file_path_2, OSMFeatures="takeaway=yes")  # -> Nodes, Tags, Report, Bounds, Debug
extract_nodes_2 = ExtractNodes(OSMFilePath=file_path_2, OSMFeatures="wheelchair=yes")  # -> Nodes, Tags, Report, Bounds, Debug
extract_ways = ExtractWays(OSMFilePath=file_path_3, OSMFeatures=text)  # -> Ways, Tags, Report, Bounds, Debug
extract_nodes_3 = ExtractNodes(OSMFilePath=file_path_3, OSMFeatures=text)  # -> Nodes, Tags, Report, Bounds, Debug
extract_buildings = ExtractBuildings(OSMFilePath=file_path, OSMFeatures=[panel, panel_2, panel_7], OutputHeighted=True)  # -> Buildings, Tags, Report, Bounds, Debug

# ---- group: Make a key to be shown in Rhino with Per-Feature Colors and Counts
data = Data(extract_nodes_3.Report)
list_item = ListItem(List=data, Index="0", Wrap=True)
list_item_2 = ListItem(List=data, Index="2", Wrap=True)
text_join = TextJoin(Text=[list_item, list_item_2], Join=", ")  # -> flatten(Result)
list_item_3 = ListItem(List=data, Index="3", Wrap=True)  # -> flatten(Item)
rectangle = Rectangle({Plane=PlaneXY(2905.73453, 3916.773105, 0), Size=Domain2(u=-591.082054..591.082054, v=-1013.869912..1013.869912)})
legend = Legend(Colour=list_item_3, Tags=text_join, Rectangle=rectangle, LegendType=1)

# ---- group: Bake all geometry into Rhino we Per-Feature Layers and Colors
bake = Button()
data_2 = Data(extract_buildings.Buildings)
data_3 = Data(extract_buildings.Report)
list_item_4 = ListItem(List=data_3, Index="3", Wrap=True)
list_item_5 = ListItem(List=data_3, Index="5", Wrap=True)
trim_tree = TrimTree(Tree=data_2, Depth=1)
create_modify_layers = CreateModifyLayers(LayerName=list_item_5, LayerColor=list_item_4, DeleteLayer=False, enableFullPath=True)  # -> LayerNames, LayerFullPath
createattributes = CreateAttributes(LayerName=create_modify_layers.LayerFullPath, enableFullPath=True)
bake_geometry = BakeGeometry(Bake=bake, Geometry=trim_tree, Attributes=createattributes, DeleteOldBakes=False, PreserveTrees=False)

# ----
arrow_distance = Slider(-7, range=-50..50)

# ---- group: Attach metadata labels to each geometry item
arrow_distance_2 = Slider(-3, range=-50..50)
label_color = ColourSwatch(SwatchColor=RGB(255, 255, 255))
geometry = Geometry(extract_buildings.Buildings)
data_4 = Data(extract_buildings.Tags)
construct_point = ConstructPoint(XCoordinate=0, YCoordinate=0, ZCoordinate=0)
brep_closest_point = BrepClosestPoint(Point=construct_point, Brep=geometry)  # -> Point, Normal, Distance
vector_xyz = VectorXYZ(XComponent=arrow_distance_2, YComponent=arrow_distance, ZComponent=0)  # -> Vector, Length
move = Move(Geometry=brep_closest_point.Point, Motion=vector_xyz.Vector)  # -> Geometry, Transform
newline = Panel("")
text_join_2 = TextJoin(Text=data_4, Join=newline)
line = Line(StartPoint=brep_closest_point.Point, EndPoint=move.Geometry)
text_tag_3d = TextTag3D(Location=move.Geometry, Text=text_join_2, Size=1, Colour=label_color, Justification=5)
custom_preview = CustomPreview(Geometry=line, Material=label_color)

# ----
geometry_2 = Geometry(extract_ways.Ways)
data_5 = Data(extract_ways.Tags)

# ---- group: Filter geometry by tag value (without using the filter component) - e.g. find all roads with a maxspeed value between X and Y
# Explanation of the two filter panels: The first panel identifies a piece of text to find that covers all possible values. Generally this takes the form of SOMETHING=* where the "*" matches any subsequent value.
# 
# The second panel identifies a piece of text to remove so that only the value/number you want to identify is present. Most of the time this will be the same as the previous panel but without the "*"
filter_for_match = Panel("maxspeed=*")
filter_to_extract_value = Panel("maxspeed=")
lower_value_limit = Slider(0, range=0..10)
upper_value_limit = Slider(48, range=0..100)
geometry_3 = Geometry(geometry_2)
data_6 = Data(data_5)
match_text = MatchText(Text=data_6, Pattern=filter_for_match, Case=False)
construct_domain = ConstructDomain(DomainStart=lower_value_limit, DomainEnd=upper_value_limit)
cull_pattern = CullPattern(List=data_6, CullPattern=match_text)
replace_text = ReplaceText(Text=cull_pattern, Find=filter_to_extract_value, RecursiveReplace=False)
includes = Includes(Value=replace_text, Domain=construct_domain)  # -> Includes, Deviation
mass_addition = MassAddition(Input=includes.Includes)  # -> Result, PartialResults
replace_nulls = ReplaceNulls(Items=mass_addition.Result, Replacements="0")  # -> Items, Count
larger_than = LargerThan(FirstNumber=replace_nulls.Items, SecondNumber=0)  # -> LargerThan, OrEqualTo
cull_pattern_2 = CullPattern(List=geometry_3, CullPattern=larger_than.LargerThan)  # -> flatten(List)
geometry_4 = Geometry(cull_pattern_2)

# ---- group: Visualise in Grasshopper with Per-Feature Colors
data_7 = Data(extract_buildings.Buildings)

colour_swatch = ColourSwatch(SwatchColor=RGB(46, 119, 255))
colour_swatch_2 = ColourSwatch(SwatchColor=RGB(161, 60, 250))
colour_swatch_3 = ColourSwatch(SwatchColor=RGB(255, 94, 218))
trim_tree_2 = TrimTree(Tree=data_7, Depth=1)

custom_preview_2 = CustomPreview(Geometry=trim_tree_2, Material=graft([colour_swatch, colour_swatch_2, colour_swatch_3]))

# ---- group: Use sets to identify items that match multiple tags simulataneously; e.g. places marked as having takeaway service AND wheelchair access
point = Point(extract_nodes.Nodes)
point_2 = Point(extract_nodes_2.Nodes)
data_8 = Data(extract_nodes.Tags)
create_set = CreateSet(List=flatten(point_2))  # -> Set, Map
create_set_2 = CreateSet(List=flatten(point))  # -> Set, Map
set_intersection = SetIntersection(SetA=create_set_2.Set, SetB=create_set.Set)
member_index = MemberIndex(Set=create_set_2.Set, Member=set_intersection)  # -> Index, Count
construct_path = ConstructPath(Indices=member_index.Index)
tree_branch = TreeBranch(Tree=simplify(data_8), Path=construct_path, MaintainPaths=True)
text_2 = Text(tree_branch)

# ----
tree_branch_2 = TreeBranch(Tree=simplify(point_2), Path=construct_path, MaintainPaths=True)

# ---- group: Use sets to identify items that match multiple tags simulataneously; e.g. places marked as having takeaway service AND wheelchair access (continued)
point_3 = Point(tree_branch_2)

# ----
panel_8 = Panel(text_2)
custom_preview_3 = CustomPreview(Geometry=point_3, Material=ColourSwatch(SwatchColor=RGB(255, 255, 255)))

# ---- group: Use sets to identify items that have one tag but not the other; e.g. places marked as having takeaway service and NOT wheelchair access
point_4 = Point(extract_nodes_2.Nodes)
point_5 = Point(extract_nodes.Nodes)
data_9 = Data(extract_nodes.Tags)
create_set_3 = CreateSet(List=flatten(point_4))  # -> Set, Map
create_set_4 = CreateSet(List=flatten(point_5))  # -> Set, Map
set_difference = SetDifference(SetA=create_set_4.Set, SetB=create_set_3.Set)
member_index_2 = MemberIndex(Set=create_set_4.Set, Member=set_difference)  # -> Index, Count
construct_path_2 = ConstructPath(Indices=member_index_2.Index)
tree_branch_3 = TreeBranch(Tree=simplify(data_9), Path=construct_path_2, MaintainPaths=True)
text_3 = Text(tree_branch_3)

# ----
tree_branch_4 = TreeBranch(Tree=simplify(point_4), Path=construct_path_2, MaintainPaths=True)

# ---- group: Use sets to identify items that have one tag but not the other; e.g. places marked as having takeaway service and NOT wheelchair access (continued)
point_6 = Point(tree_branch_4)

# ----
panel_9 = Panel(text_3)
custom_preview_4 = CustomPreview(Geometry=point_6, Material=ColourSwatch(SwatchColor=RGB(255, 255, 255)))

# ---- group: Visualise in Grasshopper with Per-Feature Colors
data_10 = Data(extract_ways.Ways)
data_11 = Data(extract_ways.Report)
list_item_6 = ListItem(List=data_11, Index="3", Wrap=True)

trim_tree_3 = TrimTree(Tree=data_10, Depth=1)

custom_preview_5 = CustomPreview(Geometry=trim_tree_3, Material=list_item_6)

data_12 = Data(extract_nodes_3.Nodes)
data_13 = Data(extract_nodes_3.Report)
list_item_7 = ListItem(List=data_13, Index="3", Wrap=True)

trim_tree_4 = TrimTree(Tree=data_12, Depth=1)

custom_preview_6 = CustomPreview(Geometry=trim_tree_4, Material=list_item_7)

# ---- group: Filter geometry by tag match (e.g. find all roads tagged as oneway and as paved) with further refinement
geometry_5 = Geometry(geometry_2)
data_14 = Data(data_5)
filter_tags = FilterTags(Items=geometry_5, Tags=data_14, selectionHidesObscure=True, selectionSerialised="oneway=yes")  # -> Items, Tags, Report, Debug
filter_tags_2 = FilterTags(Items=filter_tags.Items, Tags=filter_tags.Tags, selectionHidesObscure=True, selectionSerialised="surface=asphalt")  # -> Items, Tags, Report, Debug
filter_tags_3 = FilterTags(Items=filter_tags.Items, Tags=filter_tags.Tags, selectionHidesObscure=True, selectionSerialised="surface=paved")  # -> Items, Tags, Report, Debug
geometry_6 = Geometry(filter_tags_2.Items)

# ----
filter_tags_4 = FilterTags(
    Items=filter_tags_3.Items,
    Tags=filter_tags_3.Tags,
    selectionHidesObscure=True,
    selectionSerialised="cycleway:both=*,cycleway:left:oneway=*,cycleway:left=*,cycleway:right=*,cycleway=*")  # -> Items, Tags, Report, Debug

# ---- group: Filter geometry by tag match (e.g. find all roads tagged as oneway and as paved) with further refinement (continued)
geometry_7 = Geometry(filter_tags_4.Items)
