# Grasshopper definition Caribou - Simple Example.ghx (Grasshopper 1.0.7)
# plug-ins: Caribou

specify_features = SpecifyFeatures(
    selectionHidesObscure=True,
    selectionSerialised="amenity=bicycle_parking,highway=footway,highway=primary,highway=residential,highway=secondary,highway=tertiary")  # -> OSMFeatures, Debug
specify_features_2 = SpecifyFeatures(selectionHidesObscure=True, selectionSerialised="building=apartments")  # -> OSMFeatures, Debug

# ---- group: Reference OSM download here
# NOTE!: If you want to see this example file in action, you will need to reference a downloaded Open Street Map xml file into the file path parameter to the right ->
path = FilePath("Z:\Sites\Caribou\OSM Test Data\wellington-standard-export.osm")

# ----
extract_buildings = ExtractBuildings(OSMFilePath=path, OSMFeatures=specify_features_2.OSMFeatures, OutputHeighted=False)  # -> Buildings, Tags, Report, Bounds, Debug
extract_nodes = ExtractNodes(OSMFilePath=path, OSMFeatures=specify_features.OSMFeatures)  # -> Nodes, Tags, Report, Bounds, Debug
extract_ways = ExtractWays(OSMFilePath=path, OSMFeatures=specify_features.OSMFeatures)  # -> Ways, Tags, Report, Bounds, Debug
panel = Panel(extract_nodes.Tags)
filter_tags = FilterTags(
    Items=extract_buildings.Buildings,
    Tags=extract_buildings.Tags,
    selectionHidesObscure=True,
    selectionSerialised="building:levels=10,building:levels=11,building:levels=14,building:levels=15,building:levels=16,building:levels=17,building:levels=20,height=28.7")  # -> Items, Tags, Report, Debug
panel_2 = Panel(extract_ways.Report)
custom_preview = CustomPreview(Geometry=filter_tags.Items, Material=ColourSwatch(SwatchColor=RGB(255, 255, 255)))

# ---- group: Visualise in Grasshopper with Per-Feature Colors
data = Data(extract_ways.Ways)
data_2 = Data(extract_ways.Report)
list_item = ListItem(List=data_2, Index="3", Wrap=True)

trim_tree = TrimTree(Tree=data, Depth=1)

custom_preview_2 = CustomPreview(Geometry=trim_tree, Material=list_item)
