# Grasshopper definition Benchmarks.ghx (Grasshopper 1.0.7)
# plug-ins: ElkGHComponents, Caribou, Urbano

# ---- group: Simple XML FIle
file_path = FilePath("Z:\Sites\Caribou\Caribou.Tests\OSMxml\copenhagen-standard-export.osm")

# ---- group: Parse and Compare Craft features
file_path_2 = FilePath(file_path)
location = Location(FilePathText=file_path_2)  # -> OSMPointData, OSMFile, LongitudeDomain, LatitudeDomain
extract_ways = ExtractWays(OSMContent=file_path_2, OSMFeatures="amenity")  # -> Nodes, Tags, Report, Debug, D
import_osm_features = ImportOSMFeatures(OSMPathOrURL=file_path, OSMFeatureType="amenity", Format="xml", ImportAltitude=False)  # -> Points, Metadata, UTMZone, TranslationVector
number_slider = Slider(1, range=0..1)
osm_data = OSMData(
    OSMPointData=location.OSMPointData,
    OSMFilePath=file_path_2,
    Feature="amenity",
    Generate3d=False,
    IndividualOutputs=False)  # -> Ways, FeatureKey

file_path_3 = FilePath(file_path)
panel = Panel("highway")
location_2 = Location(FilePathText=file_path_3)  # -> OSMPointData, OSMFile, LongitudeDomain, LatitudeDomain
import_osm_street_network = ImportOSMStreetNetwork(OSMPathOrURL=file_path)  # -> StreetNetwork, StreetSegmentCurves, UTMZone, TranslationVector
number_slider_2 = Slider(1, range=0..1)
osm_data_2 = OSMData(
    OSMPointData=location_2.OSMPointData,
    OSMFilePath=file_path_3,
    Feature="highway",
    Generate3d=False,
    IndividualOutputs=False)  # -> Ways, FeatureKey
polyline = PolyLine(Vertices=osm_data_2.Ways, Closed=False)

file_path_4 = FilePath(file_path)
specify_features = SpecifyFeatures(
    selectionIncludesObscure=True,
    selectionSerialised="aerialway=*,aeroway=*,amenity=*,barrier=*,boundary=*,building=*,craft=*,emergency=*,geological=*,healthcare=*,highway=*,historic=*,landuse=*,leisure=*,man_made=*,military=*,natural=*,office=*,place=*,power=*,public_transport=*,railway=*,route=*,shop=*,sport=*,telecom=*,tourism=*,water=*,waterway=*")  # -> OSMFeatures, Debug
location_3 = Location(FilePathText=file_path_4)  # -> OSMPointData, OSMFile, LongitudeDomain, LatitudeDomain
import_osm_features_2 = ImportOSMFeatures(OSMPathOrURL=file_path, OSMFeatureType="amenity", Format="xml", ImportAltitude=False)  # -> Points, Metadata, UTMZone, TranslationVector
extract_buildings = ExtractBuildings(OSMFilePath=file_path_4, OSMFeatures=specify_features.OSMFeatures)  # -> Buildings, Tags, Report, Bounds, Debug
number_slider_3 = Slider(1, range=0..1)
osm_data_3 = OSMData(
    OSMPointData=location_3.OSMPointData,
    OSMFilePath=file_path_4,
    Feature="building",
    Generate3d=True,
    IndividualOutputs=False)  # -> Ways, Buildings, FeatureKey

# ----
extract_ways_2 = ExtractWays(OSMFilePath=file_path_3, OSMFeatures=panel)  # -> Ways, Tags, Report, Bounds, Debug
