# Grasshopper definition Melbourne.ghx (Grasshopper 1.0.7)
# plug-ins: ElkGHComponents, PancakeContract, Caribou

# ---- group: Simple XML File
path = FilePath("Z:\Sites\Caribou\Caribou.Tests\OSMxml\melbourne.xml")

# ----
specify_features = SpecifyFeatures(
    selectionIncludesObscure=True,
    selectionSerialised="aerialway=*,aeroway=*,amenity=*,barrier=*,boundary=*,building=*,craft=*,emergency=*,geological=*,healthcare=*,highway=*,historic=*,landuse=*,leisure=*,man_made=*,military=*,natural=*,office=*,place=*,power=*,public_transport=*,railway=*,route=*,shop=*,sport=*,telecom=*,tourism=*,water=*,waterway=*")  # -> OSMFeatures, Debug

# ---- group: Parse and Compare Building features and Retail subfeatures of building type
# Caribou picks up more buildings (perhaps more tolerant of different height values?) and doesn't show the height-less buildings.
file_path = FilePath(path)
location = Location(FilePathText=file_path)  # -> OSMPointData, OSMFile, LongitudeDomain, LatitudeDomain
extract_buildings = ExtractBuildings(OSMFilePath=file_path, OSMFeatures=specify_features.OSMFeatures)  # -> Buildings, Tags, Report, Bounds, Debug
assert_same_content = AssertSameContent()  # -> Satisfied, ExtraInfo; disabled

# ----
osm_data = OSMData(OSMPointData=location.OSMPointData, OSMFilePath=file_path, Feature="building", Generate3d=True, IndividualOutputs=False)  # -> Ways, Buildings, FeatureKey

# ---- group: Parse and Compare Craft features of Node type
file_path_2 = FilePath(path)
panel = Panel("craft")
location_2 = Location(FilePathText=file_path_2)  # -> OSMPointData, OSMFile, LongitudeDomain, LatitudeDomain
osm_data_2 = OSMData(
    OSMPointData=location_2.OSMPointData,
    OSMFilePath=file_path_2,
    Feature="craft",
    Generate3d=False,
    IndividualOutputs=False)  # -> Ways, FeatureKey
panel_2 = Panel(osm_data_2.Ways)

# ----
extract_nodes = ExtractNodes(OSMFilePath=file_path_2, OSMFeatures=panel)  # -> Nodes, Tags, Report, Bounds, Debug

# ---- group: Parse and Compare Craft features of Node type (continued)
panel_3 = Panel(extract_nodes.Nodes)
assert_same_content_2 = AssertSameContent(_0=flatten(osm_data_2.Ways), _1=flatten(extract_nodes.Nodes))  # -> Satisfied, ExtraInfo

# ---- group: Parse and Compare Amenity features of Node type
# Caribou picks up extra items; perhaps because it's not filtering for a pre-defined set of craft subtypes? Expected failure pending further investigation
file_path_3 = FilePath(path)
panel_4 = Panel("amenity=*")
location_3 = Location(FilePathText=file_path_3)  # -> OSMPointData, OSMFile, LongitudeDomain, LatitudeDomain
osm_data_3 = OSMData(
    OSMPointData=location_3.OSMPointData,
    OSMFilePath=file_path_3,
    Feature="amenity",
    Generate3d=False,
    IndividualOutputs=False)  # -> Ways, FeatureKey
prune_tree = PruneTree(Tree=osm_data_3.Ways, Minimum=0, Maximum="2")  # -> flatten(Tree)

# ----
extract_nodes_2 = ExtractNodes(OSMFilePath=file_path_3, OSMFeatures=panel_4)  # -> Nodes, Tags, Report, Bounds, Debug

# ---- group: Parse and Compare Amenity features of Node type (continued)
assert_same_content_3 = AssertSameContent(_0=flatten(prune_tree), _1=flatten(extract_nodes_2.Nodes))  # -> Satisfied, ExtraInfo; disabled

# ---- group: Parse and Compare Amenity features of Way type
file_path_4 = FilePath(path)
location_4 = Location(FilePathText=file_path_4)  # -> OSMPointData, OSMFile, LongitudeDomain, LatitudeDomain
extract_ways = ExtractWays(OSMContent=file_path_4, OSMFeatures="amenity")  # -> Ways, Tags, Report, Debug, D
osm_data_4 = OSMData(
    OSMPointData=location_4.OSMPointData,
    OSMFilePath=file_path_4,
    Feature="amenity",
    Generate3d=False,
    IndividualOutputs=False)  # -> Ways, FeatureKey
prune_tree_2 = PruneTree(Tree=osm_data_4.Ways, Minimum="2", Maximum=0)  # -> flatten(Tree)

# ----
explode = Explode(Curve=extract_ways.Ways, Recursive=True)  # -> Segments, flatten(Vertices)

# ---- group: Parse and Compare Amenity features of Way type (continued)
assert_same_content_4 = AssertSameContent(_0=flatten(prune_tree_2), _1=flatten(explode.Vertices))  # -> Satisfied, ExtraInfo

# ---- group: Parse and Compare Building features of way type
file_path_5 = FilePath(path)
panel_5 = Panel("building")
location_5 = Location(FilePathText=file_path_5)  # -> OSMPointData, OSMFile, LongitudeDomain, LatitudeDomain
osm_data_5 = OSMData(
    OSMPointData=location_5.OSMPointData,
    OSMFilePath=file_path_5,
    Feature="building",
    Generate3d=False,
    IndividualOutputs=False)  # -> Ways, FeatureKey

# ----
extract_ways_2 = ExtractWays(OSMContent=file_path_5, OSMFeatures=panel_5)  # -> Ways, Tags, Report, Debug, D
prune_tree_3 = PruneTree(Tree=osm_data_5.Ways, Minimum="2", Maximum=0)  # -> flatten(Tree)

# ---- group: Parse and Compare Building features of way type (continued)
explode_2 = Explode(Curve=extract_ways_2.Ways, Recursive=True)  # -> Segments, flatten(Vertices)
assert_same_content_5 = AssertSameContent(_0=flatten(prune_tree_3), _1=flatten(explode_2.Vertices))  # -> Satisfied, ExtraInfo

# ---- group: Parse and Compare Building features of node type
# Caribou picks up extra items; perhaps because it's not filtering for a pre-defined set of building subtypes? Expected failure pending further investigation
file_path_6 = FilePath(path)
location_6 = Location(FilePathText=file_path_6)  # -> OSMPointData, OSMFile, LongitudeDomain, LatitudeDomain
extract_ways_3 = ExtractWays(OSMContent=file_path_6, OSMFeatures="building")  # -> Nodes, Tags, Report, Debug, D
osm_data_6 = OSMData(
    OSMPointData=location_6.OSMPointData,
    OSMFilePath=file_path_6,
    Feature="building",
    Generate3d=False,
    IndividualOutputs=False)  # -> Ways, FeatureKey

# ----
prune_tree_4 = PruneTree(Tree=osm_data_6.Ways, Minimum=0, Maximum="2")  # -> flatten(Tree)

# ---- group: Parse and Compare Building features of node type (continued)
assert_same_content_6 = AssertSameContent(_0=flatten(prune_tree_4), _1=flatten(extract_ways_3.Nodes))  # -> Satisfied, ExtraInfo; disabled

# ---- group: Parse and Compare Building features and Retail subfeatures of way type
file_path_7 = FilePath(path)
location_7 = Location(FilePathText=file_path_7)  # -> OSMPointData, OSMFile, LongitudeDomain, LatitudeDomain
osm_data_7 = OSMData(
    OSMPointData=location_7.OSMPointData,
    OSMFilePath=file_path_7,
    Feature="building",
    Generate3d=False,
    IndividualOutputs=False,
    SelectedTypes="retail")  # -> Ways, FeatureKey
extract_ways_4 = ExtractWays(OSMContent=file_path_7, OSMFeatures="building=retail")  # -> Ways, Tags, Report, Debug, D
explode_3 = Explode(Curve=extract_ways_4.Ways, Recursive=True)  # -> Segments, flatten(Vertices)

# ----
osm_data_8 = OSMData(
    OSMPointData=location_7.OSMPointData,
    OSMFilePath=file_path_7,
    Feature="building",
    Generate3d=False,
    IndividualOutputs=True,
    SelectedTypes="retail")  # -> Retail, FeatureKey
prune_tree_5 = PruneTree(Tree=osm_data_7.Ways, Minimum="2", Maximum=0)  # -> flatten(Tree)

# ---- group: Parse and Compare Building features and Retail subfeatures of way type (continued)
assert_same_content_7 = AssertSameContent(_0=flatten(prune_tree_5), _1=flatten(explode_3.Vertices))  # -> Satisfied, ExtraInfo
