# Grasshopper definition Simple.ghx (Grasshopper 1.0.7)
# plug-ins: PancakeContract, Caribou

# ---- group: Simple XML File
path = FilePath("Z:\Sites\Caribou\Caribou.Tests\OSMxml\simple.xml")

# ---- group: Parse and Compare Craft features of Node type
file_path = FilePath(path)
extract_nodes = ExtractNodes(OSMFilePath=file_path, OSMFeatures="craft=*")  # -> Nodes, Tags, Report, Bounds, Debug
panel = Panel(extract_nodes.Tags)
point = Point([Point(8.866449773, 11501.00246, 0), Point(272.226344, 11278.6126, 0)])
assert_same_content = AssertSameContent(_0=flatten(extract_nodes.Nodes), _1=flatten(point))  # -> Satisfied, ExtraInfo

# ---- group: Parse and Compare Amenity features of Node type
file_path_2 = FilePath(path)
extract_nodes_2 = ExtractNodes(OSMFilePath=file_path_2, OSMFeatures="amenity")  # -> Nodes, Tags, Report, Bounds, Debug
panel_2 = Panel(extract_nodes_2.Nodes)
point_2 = Point(Point(542.4862675, 11449.5748, 0))
assert_same_content_2 = AssertSameContent(_0=flatten(point_2), _1=flatten(extract_nodes_2.Nodes))  # -> Satisfied, ExtraInfo

# ---- group: Parse and Compare Building features and Retail subfeatures of node type
file_path_3 = FilePath(path)
extract_nodes_3 = ExtractNodes(OSMFilePath=file_path_3, OSMFeatures="building=retail")  # -> Nodes, Tags, Report, Bounds, Debug
point_3 = Point([Point(272.226344, 11278.6126, 0), Point(192.0771495, 11201.22094, 0)])
assert_same_content_3 = AssertSameContent(_0=flatten(point_3), _1=flatten(extract_nodes_3.Nodes))  # -> Satisfied, ExtraInfo

# ----
point_4 = Point([Point(27.09973312, 11226.26203, 0), Point(43.98110234, 11233.68985, 0), Point(48.72158043, 11218.67854, 0), Point(32.91998678, 11212.8964, 0), Point(27.09973312, 11226.26203, 0), Point(48.72158043, 11218.67854, 0), Point(32.91998678, 11212.8964, 0), Point(35.29022583, 11206.11351, 0), Point(48.72158043, 11218.67854, 0)])
point_5 = Point([Point(27.09973312, 11226.26203, 0), Point(43.98110234, 11233.68985, 0), Point(48.72158043, 11218.67854, 0), Point(32.91998678, 11212.8964, 0), Point(27.09973312, 11226.26203, 0)])

# ---- group: Parse and Compare Building features and Retail subfeatures of way type
file_path_4 = FilePath(path)
extract_ways = ExtractWays(OSMFilePath=file_path_4, OSMFeatures="building")  # -> Ways, Tags, Report, Bounds, Debug
explode = Explode(Curve=extract_ways.Ways, Recursive=True)  # -> Segments, flatten(Vertices)
assert_same_content_4 = AssertSameContent(_0=flatten(point_5), _1=flatten(explode.Vertices))  # -> Satisfied, ExtraInfo

# ----
panel_3 = Panel(extract_ways.Ways)

# ---- group: Parse and Compare Building features and Retail subfeatures of way type
specify_features = SpecifyFeatures(selectionIncludesObscure=True, selectionSerialised="building=*")  # -> OSMFeatures, Debug
file_path_5 = FilePath(path)
extract_buildings = ExtractBuildings(OSMFilePath=file_path_5, OSMFeatures=specify_features.OSMFeatures)  # -> Buildings, Tags, Report, Bounds, Debug
deconstruct_brep = DeconstructBrep(Brep=extract_buildings.Buildings)  # -> Faces, Edges, Vertices
geometry = Geometry([Point(27.09973312, 11226.26203, 26), Point(43.98110234, 11233.68985, 26), Point(43.98110234, 11233.68985, 0), Point(27.09973312, 11226.26203, 0), Point(48.72158043, 11218.67854, 26), Point(48.72158043, 11218.67854, 0), Point(32.91998678, 11212.8964, 26), Point(32.91998678, 11212.8964, 0)])
assert_same_content_5 = AssertSameContent(_0=flatten(deconstruct_brep.Vertices), _1=flatten(geometry))  # -> Satisfied, ExtraInfo

# ---- group: Parse and Compare Amenity features of Way type
file_path_6 = FilePath(path)
extract_buildings_2 = ExtractBuildings(OSMFilePath=file_path_6, OSMFeatures="craft")  # -> Buildings, Tags, Report, Bounds, Debug
deconstruct_brep_2 = DeconstructBrep(Brep=extract_buildings_2.Buildings)  # -> Faces, Edges, Vertices
geometry_2 = Geometry(Tree({0;0}: [Point(27.09973312, 11226.26203, 26), Point(43.98110234, 11233.68985, 26), Point(43.98110234, 11233.68985, 0), Point(27.09973312, 11226.26203, 0), Point(48.72158043, 11218.67854, 26), Point(48.72158043, 11218.67854, 0), Point(32.91998678, 11212.8964, 26), Point(32.91998678, 11212.8964, 0)], {0;1}: [Point(48.72158043, 11218.67854, 0), Point(32.91998678, 11212.8964, 0), Point(32.91998678, 11212.8964, 15), Point(48.72158043, 11218.67854, 15), Point(35.29022583, 11206.11351, 0), Point(35.29022583, 11206.11351, 15)]))
assert_same_content_6 = AssertSameContent(_0=flatten(deconstruct_brep_2.Vertices), _1=flatten(geometry_2))  # -> Satisfied, ExtraInfo

# ---- group: Parse and Compare Building features of node type
file_path_7 = FilePath(path)
panel_4 = Panel("building")
point_6 = Point([Point(272.226344, 11278.6126, 0), Point(192.0771495, 11201.22094, 0)])

# ----
extract_nodes_4 = ExtractNodes(OSMFilePath=file_path_7, OSMFeatures=panel_4)  # -> Nodes, Tags, Report, Bounds, Debug
panel_5 = Panel(extract_nodes_4.Nodes)

# ---- group: Parse and Compare Building features of node type (continued)
assert_same_content_7 = AssertSameContent(_0=flatten(point_6), _1=flatten(extract_nodes_4.Nodes))  # -> Satisfied, ExtraInfo

# ---- group: Parse and Compare Amenity features of Way type
file_path_8 = FilePath(path)
extract_ways_2 = ExtractWays(OSMFilePath=file_path_8, OSMFeatures="craft")  # -> Ways, Tags, Report, Bounds, Debug

# ----
explode_2 = Explode(Curve=extract_ways_2.Ways, Recursive=True)  # -> Segments, flatten(Vertices)

# ---- group: Parse and Compare Amenity features of Way type (continued)
assert_same_content_8 = AssertSameContent(_0=flatten(point_4), _1=flatten(explode_2.Vertices))  # -> Satisfied, ExtraInfo
