# Grasshopper definition Caribou - Simple Example.ghx (Grasshopper 1.0.7)
# plug-ins: Caribou, Human

panel = Panel("addr:street=Taranaki Street")
panel_2 = Panel("highway=traffic_signals")
panel_3 = Panel("cuisine=mexican")
# NOTE!: If you want to see this example file in action, you will need to reference a downloaded Open Street Map xml file into the file path parameter to the right ->
specify_features = SpecifyFeatures(selectionIncludesObscure=True, selectionSerialised="craft=*,emergency=*,healthcare=*,highway=*,historic=*,landuse=*")  # -> OSMFeatures, Debug

# ---- group: Wellington CBD
path = FilePath(["/Users/philip/Sites/Caribou/Caribou.Tests/Cases/wellington-overpass-export.osm", "Z:\Sites\Caribou\Caribou.Tests\Cases\wellington-overpass-export.osm"])

# ----
text = Text(specify_features.OSMFeatures)
path_2 = FilePath(path)
extract_buildings = ExtractBuildings(OSMFilePath=path_2, OSMFeatures=["building=office", "building=apartments", "amenity=cafe"])  # -> Buildings, Tags, Report, Debug
extract_ways = ExtractWays(OSMFilePath=path_2, OSMFeatures=text)  # -> Ways, Tags, Report, Debug
extract_nodes = ExtractNodes(OSMFilePath=path_2, OSMFeatures=text)  # -> Nodes, Tags, Report, Debug

# ---- group: Visualise in Grasshopper with Per-Feature Colors
data = Data(extract_ways.Ways)
data_2 = Data(extract_ways.Report)
list_item = ListItem(List=data_2, Index="3", Wrap=True)
custom_preview = CustomPreview(Geometry=data, Material=list_item)

data_3 = Data(extract_buildings.Buildings)
data_4 = Data(extract_buildings.Report)
list_item_2 = ListItem(List=data_4, Index="3", Wrap=True)
custom_preview_2 = CustomPreview(Geometry=data_3, Material=list_item_2)

data_5 = Data(extract_nodes.Nodes)
data_6 = Data(extract_nodes.Report)
list_item_3 = ListItem(List=data_6, Index="3", Wrap=True)
custom_preview_3 = CustomPreview(Geometry=data_5, Material=list_item_3)

# ---- group: Bake all geometry into Rhino we Per-Feature Layers and Colors
bake = Button()
data_7 = Data(extract_buildings.Buildings)
data_8 = Data(extract_buildings.Report)
list_item_4 = ListItem(List=data_8, Index="3", Wrap=True)
list_item_5 = ListItem(List=data_8, Index="5", Wrap=True)
create_modify_layers = CreateModifyLayers(LayerName=list_item_5, LayerColor=list_item_4, DeleteLayer=False, enableFullPath=True)  # -> LayerNames, LayerFullPath
createattributes = CreateAttributes(LayerName=create_modify_layers.LayerFullPath, enableFullPath=True)
bake_geometry = BakeGeometry(Bake=bake, Geometry=data_7, Attributes=createattributes, DeleteOldBakes=False, PreserveTrees=False)

# ---- group: Make a key to be shown in Rhino with Per-Feature Colors and Counts
data_9 = Data(extract_nodes.Report)
list_item_6 = ListItem(List=data_9, Index="0", Wrap=True)
list_item_7 = ListItem(List=data_9, Index="2", Wrap=True)
text_join = TextJoin(Text=[list_item_6, list_item_7], Join=", ")  # -> flatten(Result)
list_item_8 = ListItem(List=data_9, Index="3", Wrap=True)  # -> flatten(Item)
rectangle = Rectangle({Plane=PlaneXY(3149691.735, 3877203.159, 0), Size=Domain2(u=-531927.6234..531927.6234, v=-869497.0767..869497.0767)})
legend = Legend(Colour=list_item_8, Tags=text_join, Rectangle=rectangle, LegendType=1)
