# Grasshopper definition Simple.ghx (Grasshopper 1.0.7)
# plug-ins: Caribou, LunchBox

panel = Panel("tests")
panel_2 = Panel("addr:street=Swanston Street")
panel_3 = Panel("waterway=")
panel_4 = Panel("highway=traffic_signals")
panel_5 = Panel("amenity=*")

# ---- group: macOS / Melbourne XML File
path = FilePath("/Users/philip/Sites/Caribou/Caribou.Tests/Cases/melbourne.xml")

# ---- group: macOS / Simple XML File
path_2 = FilePath("/Users/philip/Sites/Caribou/Caribou.Tests/Cases/simple.xml")

# ---- group: macOS / Multiple XML Files
path_3 = FilePath(["/Users/philip/Sites/Caribou/Caribou.Tests/Cases/multipleA.xml", "/Users/philip/Sites/Caribou/Caribou.Tests/Cases/multipleB.xml", "/Users/philip/Sites/Caribou/Caribou.Tests/Cases/multipleC.xml"])

# ---- group: macOS / Bigger XML Files
path_4 = FilePath(["/Users/philip/Sites/Caribou/Caribou.Tests/Cases/multipleA.xml", "/Users/philip/Sites/Caribou/Caribou.Tests/Cases/multipleB.xml", "/Users/philip/Sites/Caribou/Caribou.Tests/Cases/multipleC.xml"])

# ----
panel_6 = Panel("craft")

# ---- group: Windows / Simple XML File
path_5 = FilePath("Z:\Sites\Caribou\Caribou.Tests\Cases\simple.xml")

# ---- group: Windows / Melbourne XML File
path_6 = FilePath("Z:\Sites\Caribou\Caribou.Tests\Cases\melbourne.xml")

# ---- group: Windows / Multiple XML Files
path_7 = FilePath(["Z:\Sites\Caribou\Caribou.Tests\Cases\multipleA.xml", "Z:\Sites\Caribou\Caribou.Tests\Cases\multipleB.xml", "Z:\Sites\Caribou\Caribou.Tests\Cases\multipleC.xml"])

# ---- group: Windows / Bigger XML Files
path_8 = FilePath("Z:\Sites\Caribou\Caribou.Tests\Cases\wellington-overpass-export.osm")

# ---- group: If on Mac and ReadFile is error-ing, use this
readfile = ReadFile(Path=path_6, PerLine=False)  # -> Data
# ---------- readfile: Python ----------
"""Reads the contents of a file.
    Inputs:
        Path: The absolute path of the file to read
        PerLine: By default True to output the data line by line, or False
        Empty: By default True, or False to remove empty lines
    Output:
        Data: The file content"""

ghenv.Component.Name = "Read File"
ghenv.Component.NickName = "ReadFile"

__author__ = "diff-arch"
__version__ = "0.1.5 (2020-12-28)"


## -----------------------------------------------------------------------------


import Grasshopper as gh
import os


def read_lines(fpath):
    """Reads the contents of a file line by line.
    
    Args:
      fpath: An absolute path to a file to read
      empty: By default True to remove empty lines
    
    Raises:
      OSError: '<fpath>' is not a valid file path
      RuntimeError: Unable to read 'fname'
    
    Returns:
      The individual lines of data in a list.
    """
    lines = []
    if not os.path.exists(fpath) or not os.path.isfile(fpath):
        raise OSError("'{}' is not a valid file path".format(fpath))
    try:
        with open(fpath) as f:
            for line in f:
                if (line == '\n' or line == '\r\n'):
                    continue
                lines.append(line)
    except:
        basedir, fname = os.path.split(fpath)
        raise RuntimeError("Unable to read '{}'".format(fname))
    return lines


## -----------------------------------------------------------------------------


if __name__ == "__main__":
    # Manaage inputs
    if Path is None:
        e = "Input parameter Path failed to collect data"
        ghenv.Component.AddRuntimeMessage(
            gh.Kernel.GH_RuntimeMessageLevel.Warning, e
            )
    if PerLine is None:
        PerLine = True
        
    if Path is not None:
        # Read data from file
        lines = []
        try:
            lines = read_lines(Path)
        except Exception as e:
            ghenv.Component.AddRuntimeMessage(
                gh.Kernel.GH_RuntimeMessageLevel.Error, str(e)
                )
        # Output data
        if PerLine:
            Data = lines
        else:
            Data = "".join(lines)
# ---------- end readfile ----------

# ----
read_file = ReadFile(File=path_8, PerLineParse=False)  # -> flatten(Content)
text = Text(["building", "cuisine=mexican"])
openstreetmap = OpenStreetMap(OSMContent=read_file, OSMFeatures=text)  # -> Nodes, Tags, Report, Debug
openstreetmap_2 = OpenStreetMap(OSMContent=read_file, OSMFeatures=text)  # -> Ways, Tags, Features, Debug
point = Point(openstreetmap.Nodes)
text_2 = Text(openstreetmap.Tags)
text_3 = Text(openstreetmap.Report)
curve = Curve(openstreetmap_2.Ways)
text_4 = Text(openstreetmap_2.Tags)
text_5 = Text(openstreetmap_2.Features)
panel_7 = Panel(text_5)
panel_8 = Panel(point)
panel_9 = Panel(text_3)
panel_10 = Panel(openstreetmap.Debug)
panel_11 = Panel(curve)
panel_12 = Panel(text_4)
panel_13 = Panel(text_2)

# ---- group: Visualise in Grasshopper
point_2 = Point(point)
text_6 = Text(text_3)
list_item = ListItem(List=text_6, Index="0", Wrap=True)  # -> flatten(Item)
color_per_branch = ColorPerBranch(geometry=point_2)  # -> geometry_4, colour_2
text_7 = Text(list_item)
legend = Legend(Colour=color_per_branch.colour_2, Tags=text_7, LegendType=1)
custom_preview = CustomPreview(Geometry=color_per_branch.geometry_4, Material=color_per_branch.colour_2)

# ---- group: Bake into Rhino
text_8 = Text(text_5)
curve_2 = Curve(curve)
color_per_branch_2 = ColorPerBranch(geometry=curve_2)  # -> geometry_4, colour_2
list_item_2 = ListItem(List=text_8, Index="1", Wrap=True)  # -> flatten(Item)
object_bake = ObjectBake(
    BakeToggle=Button(),
    GeometryObjects=color_per_branch_2.geometry_4,
    Layer=list_item_2,
    ObjectName="GH_Obj",
    ObjectColor=RGB(255, 255, 255),
    LayerColor=color_per_branch_2.colour_2)

# ==== cluster ColorPerBranch
geometry = ClusterInput()
geometry_2 = Geometry(geometry)
group = Group(Objects=geometry_2)  # -> flatten(Group)
list_length = ListLength(List=group)
panel = Panel(group)
series = Series(Start=0, Step=1, Count=list_length)
gradient = Gradient(
    LowerLimit=0,
    UpperLimit=list_length,
    Parameter=series,
    stops=[0: RGB(243, 57, 0), 0.1: RGB(236, 27, 60), 0.2: RGB(210, 0, 118), 0.3: RGB(103, 0, 120), 0.4: RGB(39, 72, 161), 0.5: RGB(1, 192, 229), 0.6: RGB(18, 178, 90), 0.7: RGB(79, 186, 8), 0.8: RGB(220, 237, 32), 0.9: RGB(247, 159, 20), 1: RGB(243, 57, 0)])
geometry_3 = Geometry(geometry_2)
colour = Colour(gradient)
geometry_4 = ClusterOutput(geometry_3)
colour_2 = ClusterOutput(colour)
